# Grasshopper definition TestGraph.gh (Grasshopper 1.0.8)
# plug-ins: jSwan, Karamba3D, Human, Glab

# ----
# Node with custorm attribute
point = Point(<point referenced from the Rhino model>)
serialize_keys_and_values = SerializeKeysAndValues(Key="KeyNode", Value="NodeAttribute")
construct_node = ConstructNode(Points=point, Attributes=serialize_keys_and_values)
deconstruct_node = DeconstructNode(Node=construct_node)  # -> Properties, Point, LinkedObjects, Attributes
panel = Panel(deconstruct_node.Attributes)
panel_2 = Panel(deconstruct_node.Properties)

# ----
# Create a graph from node and edge
curve = Curve([<curve referenced from the Rhino model> x3])
serialize_keys_and_values_2 = SerializeKeysAndValues(Key="EdgeKey", Value="EdgeAttribute")
construct_edge = ConstructEdge(Curves=curve, Attributes=serialize_keys_and_values_2)
constructgraph = ConstructGraph(Nodes=construct_node, Edges=construct_edge, ShatterEdge=True)  # -> Graphs, IsolatedNodes, IsolatedEdges
deconstruct_graph = DeconstructGraph(Graph=constructgraph.Graphs)  # -> Properties, Nodes, Edges, Attributes
serialize_keys_and_values_3 = SerializeKeysAndValues(Key="KeyTest", Value="ValueTest")
panel_3 = Panel(deconstruct_graph.Properties)
longest_list = LongestList(ListListA=constructgraph.Graphs, ListListB=serialize_keys_and_values_3, PaddingMode=2)  # -> ListListA, ListListB
modifygraphelement = ModifyGraphElement(Graph=longest_list.ListListA, Attributes=longest_list.ListListB)

# ----
# Shortest path
number_slider = Slider(4, range=0..10)
rectangular = Rectangular(Plane=PlaneXY(317.6524037, 61.23681872, 0), SizeX=number_slider, SizeY=number_slider, ExtentX=10, ExtentY=5)  # -> Cells, Points
explode = Explode(Curve=flatten(rectangular.Cells), Recursive=True)  # -> Segments, Vertices
remove_duplicate_lines_karamba3d = RemoveDuplicateLinesKaramba3D(Line=flatten(explode.Segments), LimitDistance=0.005)  # -> OutLine, Info, Indexes
construct_edge_2 = ConstructEdge(Curves=remove_duplicate_lines_karamba3d.OutLine)
point_2 = Point(<point referenced from the Rhino model>)
point_3 = Point(<point referenced from the Rhino model>)
construct_graph = ConstructGraph(Edges=construct_edge_2, ShatterEdge=True)  # -> Graphs, IsolatedNodes, IsolatedEdges
find_modify_graph_node = FindModifyGraphNode(Graphs=construct_graph.Graphs, Points=[point_3, point_2])  # -> UpdatedGraphs, UpdatedNodes
list_item = ListItem(List=find_modify_graph_node.UpdatedNodes, Index=0, Wrap=True)  # -> Item, Item1
list_item_2 = ListItem(List=find_modify_graph_node.UpdatedNodes, Index=0, Wrap=True)  # -> Item, Item1
merge = Merge(Data1=list_item_2.Item, Data2=list_item_2.Item1)
merge_2 = Merge(Data1=list_item.Item1, Data2=list_item.Item)
longest_list_2 = LongestList(ListListA=construct_graph.Graphs, ListListB=merge, ListA=merge_2, PaddingMode=2)  # -> graft(ListListA), graft(ListListB), graft(ListA)
find_shortest_path = FindShortestPath(Graphs=longest_list_2.ListListA, StartNodes=longest_list_2.ListListB, EndNodes=longest_list_2.ListA)  # -> PathNodes, PathEdges, PathLength
panel_4 = Panel(find_shortest_path.PathLength)
deconstruct_edge = DeconstructEdge(Edge=find_shortest_path.PathEdges)  # -> Properties, SourceNode, TargetNode, Geometry, LinkedObjects, Attributes
panel_5 = Panel(deconstruct_edge.Properties)
custom_preview_lineweights = CustomPreviewLineweights(
    Geometry=deconstruct_edge.Geometry,
    Shader={diffuse=RGB(255, 105, 180), emission=RGB(76, 32, 54), shine=0.5, specular=RGB(255, 255, 255), transparency=0},
    Thickness=Slider(7, range=0..10),
    Absolute=False)

curve_2 = Curve([<curve referenced from the Rhino model> x2])
point_4 = Point(<point referenced from the Rhino model>)
curve_3 = Curve(<curve referenced from the Rhino model>)

# ----
# Create graph with linked object
point_5 = Point(<point referenced from the Rhino model>)
brep = Brep(<brep referenced from the Rhino model>)
curve_4 = Curve(<curve referenced from the Rhino model>)
curve_5 = Curve(<curve referenced from the Rhino model>)
brep_2 = Brep(<brep referenced from the Rhino model>)
brep_3 = Brep(<brep referenced from the Rhino model>)
construct_node_2 = ConstructNode(Points=point_5, LinkedObjects=brep)
construct_edge_3 = ConstructEdge(Curves=curve_4, LinkedObjects=brep_3)
construct_edge_4 = ConstructEdge(Curves=curve_5, LinkedObjects=brep_2)
construct_graph_2 = ConstructGraph(Nodes=construct_node_2, Edges=[construct_edge_3, construct_edge_4], ShatterEdge=True)  # -> Graphs, IsolatedNodes, IsolatedEdges
deconstruct_graph_2 = DeconstructGraph(Graph=construct_graph_2.Graphs)  # -> Properties, Nodes, Edges, Attributes
deconstruct_edge_2 = DeconstructEdge(Edge=deconstruct_graph_2.Edges)  # -> Properties, SourceNode, TargetNode, Geometry, LinkedObjects, Attributes
deconstruct_node_2 = DeconstructNode(Node=deconstruct_graph_2.Nodes)  # -> Properties, Point, LinkedObjects, Attributes

# ----
# Skeleton graph from 2D boundary -> Prune -> Simplify
curve_6 = Curve(<curve referenced from the Rhino model>)
skeletonizeboundary = SkeletonizeBoundary(BoundaryCurve=curve_6, DivisionLength=Slider(5, range=0..10))  # -> SkeletonCurves, SkeletonGraphs
integer = Integer(Slider(1, range=0..10))
serialize_keys_and_values_4 = SerializeKeysAndValues(Key="Valence", Value=integer)
point_6 = Point([<point referenced from the Rhino model> x2])
panel_6 = Panel(serialize_keys_and_values_4)
find_modify_graph_node_2 = FindModifyGraphNode(Graphs=skeletonizeboundary.SkeletonGraphs, Points=point_6, Type="NoPrune")  # -> UpdatedGraphs, UpdatedNodes
filter_node_and_edge = FilterNodeAndEdge(Graphs=find_modify_graph_node_2.UpdatedGraphs, Type="NoPrune", Properties=panel_6)  # -> FilteredNodes, FilteredEdges
prune_graph_node = PruneGraphNode(Graphs=find_modify_graph_node_2.UpdatedGraphs, ValenceToPrune=1, TypeToExclude="NoPrune", PruneTypeNullOnly=True)
deconstruct_node_3 = DeconstructNode(Node=filter_node_and_edge.FilteredNodes)  # -> Properties, Point, LinkedObjects, Attributes
panel_7 = Panel(deconstruct_node_3.Properties)
simplify_graph = SimplifyGraph(Graphs=prune_graph_node, MinAngle=160, MaxAngle=180, CollapseShortEdges=invert(False), MinLength=Slider(2, range=0..10))
visualize_graph = VisualizeGraph(
    Graphs=simplify_graph,
    PreviewColor=RGB(0, 100, 0),
    ShowNodeValence=True,
    ShowEdgeValence=False,
    ShowNodeProperties=False,
    ShowNodeAttribute=False,
    ShowEdgeAsArc=True)

# ----
# Create multiple graph
point_7 = Point(<point referenced from the Rhino model>)
curve_7 = Curve([<curve referenced from the Rhino model> x5])
construct_node_3 = ConstructNode(Points=point_7)
construct_edge_5 = ConstructEdge(Curves=curve_7)
constructgraph_2 = ConstructGraph(Nodes=construct_node_3, Edges=construct_edge_5, ShatterEdge=True)  # -> Graphs, IsolatedNodes, IsolatedEdges

construct_node_4 = ConstructNode(Points=point_4)
construct_edge_6 = ConstructEdge(Curves=curve_2)
construct_edge_7 = ConstructEdge(Curves=curve_3)
construct_graph_3 = ConstructGraph(Edges=construct_edge_6, ShatterEdge=True)  # -> Graphs, IsolatedNodes, IsolatedEdges
construct_graph_4 = ConstructGraph(Nodes=construct_node_4, Edges=construct_edge_7, ShatterEdge=True)  # -> Graphs, IsolatedNodes, IsolatedEdges

# ----
# Connect node to graph
point_8 = Point([<point referenced from the Rhino model> x2])
serialize_keys_and_values_5 = SerializeKeysAndValues(Key="Test", Value="Test")
construct_node_5 = ConstructNode(Points=point_8, Attributes=serialize_keys_and_values_5)
connect_node_to_graph = ConnectNodeToGraph(Graphs=construct_graph_4.Graphs, Nodes=construct_node_5)
deconstruct_graph_3 = DeconstructGraph(Graph=connect_node_to_graph)  # -> Properties, Nodes, Edges, Attributes
deconstruct_node_4 = DeconstructNode(Node=deconstruct_graph_3.Nodes)  # -> Properties, Point, LinkedObjects, Attributes
panel_8 = Panel(deconstruct_graph_3.Properties)
panel_9 = Panel(deconstruct_node_4.Properties)

visualize_graph_2 = VisualizeGraph(
    Graphs=constructgraph_2.Graphs,
    PreviewColor=RGB(0, 100, 0),
    ShowNodeValence=True,
    ShowEdgeValence=False,
    ShowNodeProperties=False,
    ShowNodeAttribute=False,
    ShowEdgeAsArc=True)

# ----
# Export graph to JSON
panel_10 = Panel("E:\Desktop\Graph.JSON")
export_graph_to_json = ExportGraphToJSON(Graph=[construct_graph_3.Graphs, construct_graph_4.Graphs], FilePath=panel_10, IncludeGeometry=True, Export=Button())
panel_11 = Panel(export_graph_to_json)

# ----
# Find closest graph
point_9 = Point(<point referenced from the Rhino model>)
find_closest_graph = FindClosestGraph(Graphs=[construct_graph_3.Graphs, construct_graph_4.Graphs], TestPoints=point_9)  # -> ClosestGraphs, Distances

# ----
# Create a graph
# from edge only
constructgraph_3 = ConstructGraph(Edges=construct_edge, ShatterEdge=True)  # -> Graphs, IsolatedNodes, IsolatedEdges

visualize_graph_3 = VisualizeGraph(
    Graphs=modifygraphelement,
    PreviewColor=RGB(0, 100, 0),
    ShowNodeValence=True,
    ShowEdgeValence=False,
    ShowNodeProperties=False,
    ShowNodeAttribute=False,
    ShowEdgeAsArc=True)

# ----
# Deconstruct
# graph data
deconstruct_graph_4 = DeconstructGraph(Graph=modifygraphelement)  # -> Properties, Nodes, Edges, Attributes
panel_12 = Panel(deconstruct_graph_4.Attributes)
panel_13 = Panel(deconstruct_graph_4.Properties)
deconstruct_node_5 = DeconstructNode(Node=deconstruct_graph_4.Nodes)  # -> Properties, Point, LinkedObjects, Attributes
deconstruct_edge_3 = DeconstructEdge(Edge=deconstruct_graph_4.Edges)  # -> Properties, SourceNode, TargetNode, Geometry, LinkedObjects, Attributes
panel_14 = Panel(deconstruct_node_5.Properties)
panel_15 = Panel(deconstruct_edge_3.Properties)

# ----
# Find node by Point
# and add Type & Attribute
panel_16 = Panel("NodeAttribute2")
point_10 = Point([<point referenced from the Rhino model> x2])
serialize_keys_and_values_6 = SerializeKeysAndValues(Key="KeyNode2", Value=panel_16)
find_modify_graph_node_3 = FindModifyGraphNode(Graphs=constructgraph_3.Graphs, Points=point_10, Type="A", Attributes=serialize_keys_and_values_6)  # -> UpdatedGraphs, UpdatedNodes
deconstruct_node_6 = DeconstructNode(Node=find_modify_graph_node_3.UpdatedNodes)  # -> Properties, Point, LinkedObjects, Attributes
panel_17 = Panel(deconstruct_node_6.Properties)

visualize_graph_4 = VisualizeGraph(
    Graphs=connect_node_to_graph,
    PreviewColor=RGB(0, 100, 0),
    ShowNodeValence=invert(True),
    ShowEdgeValence=invert(False),
    ShowNodeProperties=invert(False),
    ShowNodeAttribute=False,
    ShowEdgeAsArc=True)
visualize_graph_5 = VisualizeGraph(
    Graphs=find_closest_graph.ClosestGraphs,
    PreviewColor=RGB(0, 100, 0),
    ShowNodeValence=True,
    ShowEdgeValence=False,
    ShowNodeProperties=False,
    ShowNodeAttribute=False,
    ShowEdgeAsArc=True)

# ----
# Find and modify
# edge attribute
curve_8 = Curve(<curve referenced from the Rhino model>)
serialize_keys_and_values_7 = SerializeKeysAndValues(Key="KeyTest", Value="ValueTest")
findedgebyline = FindEdgeByLine(Graphs=modifygraphelement, Lines=curve_8, Type="C", Attributes=serialize_keys_and_values_7)  # -> UpdatedGraphs, Edges
deconstruct_edge_4 = DeconstructEdge(Edge=findedgebyline.Edges)  # -> Properties, SourceNode, TargetNode, Geometry, LinkedObjects, Attributes
panel_18 = Panel(deconstruct_edge_4.Attributes)
panel_19 = Panel(deconstruct_edge_4.Properties)

# ----
# Split graph into
# subgraphs at point
point_11 = Point(<point referenced from the Rhino model>)
splitgraphatpoint = SplitGraphAtPoint(Graphs=findedgebyline.UpdatedGraphs, Points=point_11)
list_item_3 = ListItem(List=splitgraphatpoint, Index=Slider(1, range=0..10), Wrap=True)

# ----
# Merge connected graph
merge_3 = Merge(Data1=modifygraphelement, Data2=find_modify_graph_node_3.UpdatedGraphs)
mergegraphs = MergeGraphs(Graphs=flatten(merge_3))
deconstruct_graph_5 = DeconstructGraph(Graph=mergegraphs)  # -> Properties, Nodes, Edges, Attributes
panel_20 = Panel(deconstruct_graph_5.Properties)
deconstruct_node_7 = DeconstructNode(Node=deconstruct_graph_5.Nodes)  # -> Properties, Point, LinkedObjects, Attributes
panel_21 = Panel(deconstruct_node_7.Properties)

visualize_graph_6 = VisualizeGraph(
    Graphs=list_item_3,
    PreviewColor=RGB(0, 100, 0),
    ShowNodeValence=True,
    ShowEdgeValence=False,
    ShowNodeProperties=False,
    ShowNodeAttribute=False,
    ShowEdgeAsArc=True)
visualize_graph_7 = VisualizeGraph(
    Graphs=mergegraphs,
    PreviewColor=RGB(0, 100, 0),
    ShowNodeValence=True,
    ShowEdgeValence=False,
    ShowNodeProperties=False,
    ShowNodeAttribute=False,
    ShowEdgeAsArc=True)

# ----
# Filter edge by type
panel_22 = Panel("C")
filter_node_and_edge_2 = FilterNodeAndEdge(Graphs=list_item_3, Type=panel_22)  # -> FilteredNodes, FilteredEdges
deconstruct_edge_5 = DeconstructEdge(Edge=filter_node_and_edge_2.FilteredEdges)  # -> Properties, SourceNode, TargetNode, Geometry, LinkedObjects, Attributes
panel_23 = Panel(deconstruct_edge_5.Properties)

# ----
# Filter node by properties
number_slider_2 = Slider(1, range=0..10)
integer_2 = Integer(number_slider_2)
serialize_keys_and_values_8 = SerializeKeysAndValues(Key="Valence", Value=integer_2)
panel_24 = Panel(serialize_keys_and_values_8)
filter_node_and_edge_3 = FilterNodeAndEdge(Graphs=list_item_3, Properties=panel_24)  # -> FilteredNodes, FilteredEdges
deconstruct_node_8 = DeconstructNode(Node=filter_node_and_edge_3.FilteredNodes)  # -> Properties, Point, LinkedObjects, Attributes
panel_25 = Panel(deconstruct_node_8.Properties)
